# Dynamo graph LegendGenerator.dyn (Dynamo 2.17.0.3472)

# group: Layers To Remove
# By this method we are providing layers to ignore which are in the target document while create legends which are stored in text file.
file_path = Filename(".\layers_To_Remove.txt")
file_from_path = FileObject(path=file_path)
readText = FileSystem.ReadText(file=file_from_path)
code_block = CodeBlock { "\n"; }
split = String.Split(string=readText, separator0=code_block)

# group: Current Document
# By this method we are getting all the layers of the current document and the instance of its modelspace for further work(output)
current = Autodesk.AutoCAD.DynamoNodes.Document.Current()
layers = Autodesk.AutoCAD.DynamoNodes.Document.Layers(document=current)
modelSpace = Autodesk.AutoCAD.DynamoNodes.Document.ModelSpace(document=current)

filter_target_layers_for_legends = Python(IN[0]=split, IN[1]=layers)  # CPython3
# ---------- filter_target_layers_for_legends.python (6 lines) ----------
layersToRemove=list(IN[0])
docLayers=list(IN[1])
for layer in layersToRemove:
    if layer.replace("\n", "") in docLayers:
        docLayers.remove(layer)
OUT=docLayers
# ----------------------------------------
y_coordinateforstartingpoints_of = Python(IN[0]=filter_target_layers_for_legends)  # "Y_coordinateForStartingPoints of lines Generator"; CPython3
# ---------- y_coordinateforstartingpoints_of.python (9 lines) ----------
listOfLayers=list(IN[0])
numberOfLayers=len(listOfLayers)
ycoordinatesForLineStart=[]
coordinateBuffer=0
gapBetweenLines=6.339
for i in range(numberOfLayers):
    ycoordinatesForLineStart.append(coordinateBuffer)
    coordinateBuffer=float(coordinateBuffer - 6.339)
OUT=ycoordinatesForLineStart
# ----------------------------------------

# group: Start Point Group For Lines.
# By this method we are generating points in a list form that would represent the start point of the respective utility lines.
x_co_for_starting_points_of = CodeBlock { 0; }  # "X_Co. for starting points of lines"
byCoordinates = Point.ByCoordinates(x=x_co_for_starting_points_of, y=y_coordinateforstartingpoints_of)

number = DoubleInput(0)
count = List.Count(list=filter_target_layers_for_legends)
number_2 = DoubleInput(-6.339)
sequence = Sequence(start=number, amount=count, step=number_2)

# group: End Point Group For Lines.
# By this method we are generating points in a list form that would represent the end point of the respective utility lines.
x_co_for_end_points_of_lines = CodeBlock { 30; }
byCoordinates_2 = Point.ByCoordinates(x=x_co_for_end_points_of_lines, y=sequence)

# group: Layer Source
# By this method we are parsing layes and their respective keys from an excel file as reference.
file_path_2 = Filename("C:\Users\KUMA8476\OneDrive Corp\OneDrive - AtkinsRéalis\Desktop\Python\utilitylayerizer\source.xlsx")
file_from_path_2 = FileObject(path=file_path_2)
string = StringInput("Sheet1")
boolean = BoolSelector(true)
importExcel = Data.ImportExcel(file=file_from_path_2, sheetName=string, readAsStrings=boolean)
source_layers_list = Python(IN[0]=importExcel)  # CPython3
# ---------- source_layers_list.python (5 lines) ----------
data=IN[0]
layerList=[]
for i in data:
    layerList.append(i[2])
OUT=layerList
# ----------------------------------------
source_keys_list = Python(IN[0]=importExcel)  # CPython3
# ---------- source_keys_list.python (5 lines) ----------
data=IN[0]
keyNames=[]
for i in data:
    keyNames.append(i[1])
OUT=keyNames    
# ----------------------------------------

list_of_keys_to_be_used = Python(IN[0]=source_layers_list, IN[1]=source_keys_list, IN[2]=filter_target_layers_for_legends)  # CPython3
# ---------- list_of_keys_to_be_used.python (12 lines) ----------
sourceLayers=list(IN[0])
sourceKeys=list(IN[1])
docLayers=list(IN[2])
keys=[]
for layer in docLayers:
    if str(layer) in sourceLayers:
        LayerIndex = sourceLayers.index(layer)
        keyForthisLayer=sourceKeys[LayerIndex]
        keys.append(keyForthisLayer)
    else:
        keys.append("not found")
OUT=keys
# ----------------------------------------

# group: LENGTH/WIDTH of KEY
# By these inputs we can set the text height and the max key length so that key would come in single line.
number_3 = DoubleInput(100)
number_4 = DoubleInput(2.5)

# group: Legends and keys
# This is the output Legend and the respective key generated  by this program.
byTwoPoints = Autodesk.AutoCAD.DynamoNodes.Line.ByTwoPoints(startPoint=byCoordinates, endPoint=byCoordinates_2, layer=filter_target_layers_for_legends, block=modelSpace)
create = Autodesk.AutoCAD.DynamoNodes.MText.Create(text=list_of_keys_to_be_used, insertionPoint=byCoordinates_2, width=number_3, height=number_4, layer=filter_target_layers_for_legends, block=modelSpace)

# group: Feedback To the Tool Usage Traker
# By this method we are updating the tool tracker by this instance of use by this user.
python_script = Python(IN[0]=current)  # CPython3
# ---------- python_script.python (5 lines) ----------
import os
user=os.getenv("USERNAME")
document=IN[0]
url=f"http://127.0.0.1:5000/analyse?user={user}&document={document}"
OUT=url
# ----------------------------------------
web_request = WebRequest(url=python_script)  # graph output
